# Dynamo graph Random Single Story Building.dyn (Dynamo 2.1.0.6085)

number_slider = DoubleSlider(10000, range=0..10000 step 0.1)  # graph input
number_slider_2 = DoubleSlider(20000, range=0..20000 step 0.1)  # graph input
byCoordinates = Point.ByCoordinates(x=number_slider, y=number_slider_2)
number_slider_3 = DoubleSlider(2000, range=0..3000 step 0.1)  # graph input
number_slider_4 = DoubleSlider(0, range=0..1000 step 0.1)  # graph input
byCoordinates_2 = Point.ByCoordinates(x=number_slider_3, y=number_slider_4)
number_slider_5 = DoubleSlider(0, range=0..100 step 0.1)  # graph input
number_slider_6 = DoubleSlider(0, range=0..500 step 0.1)  # graph input
byCoordinates_3 = Point.ByCoordinates(x=number_slider_5, y=number_slider_6)
number_slider_7 = DoubleSlider(0, range=0..100 step 0.1)  # graph input
number_slider_8 = DoubleSlider(25000, range=0..25000 step 0.1)  # graph input
byCoordinates_4 = Point.ByCoordinates(x=number_slider_7, y=number_slider_8)
create = List.Create(item0=byCoordinates, item1=byCoordinates_2, item2=byCoordinates_3, item3=byCoordinates_4)
boolean = BoolSelector(true)  # graph input
byPoints = PolyCurve.ByPoints(points=create, connectLastToFirst=boolean)
curves = PolyCurve.Curves(polyCurve=byPoints)
levels = Levels(index=0)  # graph input
levels_2 = Levels(index=1)  # graph input
wall_types = WallTypes(index=11)  # graph input
byCurveAndLevels = Wall.ByCurveAndLevels(c=curves, startLevel=levels, endLevel=levels_2, wallType=wall_types)
flatten = List.Flatten(list=curves)
floor_types = FloorTypes(index=2)  # graph input
byOutlineTypeAndLevel = Floor.ByOutlineTypeAndLevel(outline=flatten, floorType=floor_types, level=levels)
family_types = FamilyTypes(index=122)
categories = Categories(index=589)
all_elements_of_category = ElementsOfCategory(Category=categories)
getLocation = Element.GetLocation(element=all_elements_of_category)
integer_slider = IntegerSlider(2, range=0..10 step 1)
pointsAtEqualChordLength = Curve.PointsAtEqualChordLength(curve=getLocation, divisions=integer_slider)
X = Point.X(point=pointsAtEqualChordLength)
Y = Point.Y(point=pointsAtEqualChordLength)
Z = Point.Z(point=pointsAtEqualChordLength)
integer_slider_2 = IntegerSlider(2, range=0..10 step 1)
add = Z + integer_slider_2
byCoordinates_5 = Point.ByCoordinates(x=X, y=Y, z=add)
parameters = Element.Parameters()  # unwired: element
code_block = CodeBlock { "Generic Roof - 300mm"; }
byName = RoofType.ByName(name=code_block)
levels_3 = Levels(index=1)  # graph input
byOutlineTypeAndLevel_2 = Roof.ByOutlineTypeAndLevel(outline=flatten, roofType=byName, level=levels_3)
boolean_2 = BoolSelector(true)
number = DoubleInput(20)
setRoofByFootPrintSlope = hsbCustomizableRoofs.hsbCustomizableRoofByFootPrint.SetRoofByFootPrintSlope(Roof=byOutlineTypeAndLevel_2, DefinesSlope=boolean_2, SlopeAngle=number)
